# Dynamo graph manual_graph.dyn (Dynamo 3.3.0.6316)

integer_slider = IntegerSlider(69, range=0..100 step 1)
mult = CodeBlock(x=integer_slider) { x*2; }
squareroot = Python(IN[0]=mult)  # CPython3
# ---------- squareroot.python (3 lines) ----------
import math

OUT = math.sqrt(IN[0])
# ----------------------------------------
add = squareroot + mult
