# Dynamo graph revit_test.dyn (Dynamo 3.3.0.6316)

select_model_element = DSModelElementSelection()  # 1 picked in the model
id = Element.Id(element=select_model_element)
element_by_id = ElementById(Id=id)
